vi "Modulation test.gvi"   [LabVIEW Communications System Design Suite 2.0.1]
panel controls:
  "symbol rate": f64 = 10000
  "PSK Parameters": T2 = {"samples per symbol"=16, "M-PSK"=2, "differential PSK"="enable", "PSK type"="normal"}
  "Tab": i32
  "Burst Parameters": "Burst Parameters.gtype" = {"# Message Symbols"=1000, "# Guard Symbols"=80, "Sync Bits"=64250}
  "Cluster Constant": "Filter.gtype" = {"Transmit filter"="Root Raised Cos", "Pulse filter parameter"=0.5, "Receive filter"="Root Raised Cos", "Matched filter parameter"=0.5}
  "Coding and CRC": "Coding and CRC.gtype" = {"Rate (k/n)"="1/2", "CRC seed"=56797}
panel indicators:
  "Constellation": T1[]
  "Modulation": f64[]
  "Demodulation": f64[][]
  "Sync found": bool
  "CRC": u16
  "Error Out": error
types:
  T1 = cluster{"constellation": f64[], "oversampled data": f64[]}
  T2 = cluster{"samples per symbol": i32, "M-PSK": i32, "differential PSK": enum{"disable", "enable"}, "PSK type": enum{"normal", "shifted", "offset"}}
  "Burst Parameters.gtype" = cluster{"# Message Symbols": i32, "# Guard Symbols": i32, "Sync Bits": u16}
  T3 = enum{"none", "Raised Cosine", "Root Raised Cos", "Gaussian"}
  "Filter.gtype" = cluster{"Transmit filter": T3, "Pulse filter parameter": f64, "Receive filter": T3, "Matched filter parameter": f64}
  "Coding and CRC.gtype" = cluster{"Rate (k/n)": enum{"1/2", "2/3"}, "CRC seed": u16}
diagram:
  call "Modulation init.gvi"(PSK Parameters=$"PSK Parameters", Filter=$"Cluster Constant", Burst Parameters=$"Burst Parameters", Coding and CRC=$"Coding and CRC") -> (Demodulation parameters=w1, Modulation parameters=w2, error out=w3)
  # --------INITIALIZATION------
  # ----------------------------------TRANSMITTER-----------------------------------------
  Property Node(instance in=$"Burst Parameters") -> ("# Message Symbols"=w4, "# Guard Symbols"=w5, "Sync Bits"=w6)
  Property Node(instance in=$"Coding and CRC") -> ("Rate (k/n)"=w7)
  call "Message bit generation.gvi"(# Message Symbols=w4, error in=w3) -> (Output Bit Stream=w8, error out=w9)
  Array Size(array=w8) -> (size(s)=w10)
  call "CRC.gvi"(Message In=w8, Error In=w9, Forward?=TRUE, # of MSG bits=w10) -> (Data out=w11, Error Out=w12)
  call "Convolutional Coder.gvi"(Input bitstream=w11, Rate (k/n)=w7, Error in=w12) -> (Coded bit stream=w13, Error out=w14)
  Number To Boolean Array(number=w6) -> (Boolean array=w15)
  Boolean To Integer(Boolean=w15) -> (0, 1=w16)
  To Byte Integer(number=w16) -> w17
  call "Burst Building.gvi"(Sync Bits [#16]=w17, Input bit stream=w13, error in=w14, # Guard Symbols=w5) -> (Output bit stream=w18, error out=w19)
  call "Modulation (PSK).gvi"(input bit stream=w18, Modulation parameters=w2, symbol rate=$"symbol rate", error in=w19) -> (error out=w20, output complex waveform=w21)
  call "Demodulation (PSK).gvi"(Waveform in=w21, error in=w20, Demodulation parameters=w1) -> (Messages out=w22, error out=w23, Sync found=w24, output complex waveform=w25)
  call "MT Format Constellation.gvi"(waveform=w25, samples per symbol=16) -> (constellation graph=w26)
  $Constellation <- w26
  Property Node(instance in=w25) -> ("Y"=w27)
  Complex To Real Imaginary(x + iy=w27) -> (x=w28)
  $Modulation <- w28
  # -------------------------------------RECIEVER------------------------------------
  s1 = w23  # shift register
  for {
    w29 = each element of w22
    Property Node(instance in=w1)
    $"Sync found" <- w24
    To Double Precision Float(number=w8) -> w30
    call "Convolutional Decoder.gvi"(Coding rate=w7, Coded bit stream=w29, Error in=s1) -> (Decoded bits=w31, Error Out=w32)
    call "CRC.gvi"(Message In=w31, Error In=w32, Forward?=FALSE, # of MSG bits=w10) -> (Data out=w33, CRC value=w34, Error Out=w35)
    To Double Precision Float(number=w33) -> w36
    Build Array(w30, w36) -> w37
    $Demodulation <- w37
    Add Array Elements(numeric array=w34) -> (sum=w38)
    $CRC <- w38
    next s1 = w35
  }
  $"Error Out" <- s1
  call "Display Error.gvi"(error in=s1)
